# Grasshopper definition 00_point_in_time_gridbased.gh (Grasshopper 1.0.4)

# Point in time daylight simulation aka Grid-based
# This is the same as grid-based daylight simulation in honeybee.
path = FilePath("C:\EnergyPlusV8-6-0\WeatherData\USA_IL_Chicago-OHare.Intl.AP.725300_TMY3.epw")
# Geometry Preparation
number_slider = Slider(0.762, range=0..1)
wea = HoneybeePlus_Wea(epwFile=path)  # -> wea; plug-in component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
# Room geometry except for the openings.
# Types and materials will be assigned
# based on normal direction.
# 
# These geometries are under ./scene/opaque
panel = Panel("0.55")
importloc = LadybugPlus_ImportLocation(epwFile=path)  # -> location; plug-in component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

# ---- group: opaque surfaces
brep = Brep([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])
wires = BrepWireframe(Brep=brep, Density=-1)
preview = CustomPreview(Geometry=wires, Shader=ColourSwatch(SwatchColor=RGB(0, 0, 0)))
hbsurface = HoneybeePlus_HoneybeeSurface(geo=brep)  # -> report, HBSrf; plug-in component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

# ----
# Generate test points
# You can use any other grasshopper
# components to generate these points.
brep_2 = Brep([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])
# Sky
panel_2 = Panel("9")
gentestpts = Honeybee_GenerateTestPoints(testGeometry=brep_2, gridSize="1", distBaseSrf=number_slider, moveTestMesh=True)  # -> readMe, simplify(testPoints), simplify(ptsVectors), simplify(facesArea), simplify(mesh); plug-in component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
panel_3 = Panel("21")
# Windows are added to the scene
# as normal windows. They will be grouped
# together with room geometries.
# check ./scene/glazing
brep_3 = Brep([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])
wires_2 = BrepWireframe(Brep=brep_2, Density=-1)
radglassmaterial = HoneybeePlus_RadianceGlassMaterial(name="g_material", tVis=panel)  # -> material; plug-in component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

# ---- group: context!
brep_4 = Brep([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])
debrep = DeconstructBrep(Brep=brep_4)  # -> flatten(Faces), Edges, Vertices

# ----
# Use any of the sky components to
# generate the sky for the simulation.
# 
# Sky will be created under ./sky folder.
climatebased = HoneybeePlus_ClimatebasedSky(wea=wea)  # -> sky; plug-in component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
ciesky = HoneybeePlus_CIEStandardSky(location=importloc, month=6, day=21, type=0)  # -> sky; plug-in component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
preview_2 = CustomPreview(Geometry=brep_3, Shader=ColourSwatch(SwatchColor=RGBA(65, 114, 255, 72)))
certainillum = HoneybeePlus_CertainIlluminance()  # -> sky; plug-in component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
panel_4 = Panel(radglassmaterial)
panel_5 = Panel("""room_a
room_b""")
hbwinsrf = HoneybeePlus_HoneybeeWindowSurface(geo=brep_3, radMat=radglassmaterial)  # -> report, HBWinSrf; plug-in component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
hbsurface_2 = HoneybeePlus_HoneybeeSurface(geo=debrep.Faces)  # -> report, HBSrf; plug-in component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
data = Data(climatebased)
graft = GraftTree(Tree=panel_5, IncludeEmptyLists=True, IncludeNullItems=True)
# Analysis Grid
analysisgrid = HoneybeePlus_AnalysisGrid(name=graft, testPoints=gentestpts.testPoints)  # -> analysisGrid; plug-in component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
flatten = FlattenTree(Tree=analysisgrid, Path="{0}")
data_2 = Data(flatten([hbsurface_2.HBSrf, hbsurface.HBSrf, hbwinsrf.HBWinSrf]))
# Recipe
gridbasedrecipe = HoneybeePlus_GridBasedRecipe(sky=data, analysisGrids=flatten, analysisType=0)  # -> out, analysisRecipe; plug-in component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
toggle = BooleanToggle(False)
panel_6 = Panel(gridbasedrecipe.out)
runradiance = HoneybeePlus_RunRadianceAnalysis(
    analysisRecipe=gridbasedrecipe.analysisRecipe,
    HBObjects=data_2,
    folder="c:\ladybug",
    name="sample_files",
    write=toggle,
    run=toggle)  # -> report, legendPar, outputs; plug-in component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
# Run the simulation
# Set write to True to save the files to
# the project folder. This gives you the
# option to check the files before running
# the simulation.
# 
# Once ready also set run to True and the
# component will run the study. The output
# will be the analysis grids or an image
# collection based on the analysis type.
# 
# Results will be stored under ./result
panel_7 = Panel(runradiance.report)
# Post process
# Result visualization
# In case of grid-based analysis the result
# is only available for the single hour of
# the simulation.
hourlyvalues = HoneybeePlus_HourlyValues(analysisGrid=runradiance.outputs)  # -> report, values; plug-in component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
panel_8 = Panel(hourlyvalues.report)

# ---- group: temporary solution until ladybug[+] is ready!
python = PythonScript(x=runradiance.legendPar)  # -> a, b, c, d
# ---------- python: Python ----------
from System.Drawing import Color
if x:
    a = x.domain[0]
    b = x.domain[-1]
    c = 11
    d = (Color.FromArgb(1, c.r, c.g, c.b) for c in x.colors)
# ---------- end python ----------

# ----
legendpar = Ladybug_LegendParameters(lowBound=python.a, highBound=python.b, numSegments=python.c, customColors=flatten(python.d))  # -> legendPar; plug-in component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
flatten_2 = FlattenTree(Tree=hourlyvalues.values, Path="{0}")
panel_9 = Panel("""point in time
simulation""")
flatten_3 = FlattenTree(Tree=gentestpts.mesh, Path="{0}")
mjoin = MeshJoin(Meshes=flatten_3)
recolormesh = Ladybug_RecolorMesh(analysisResult=flatten_2, inputMesh=mjoin, legendPar=legendpar, analysisTitle=panel_9, legendTitle="lux")  # -> readMe, newMesh, newLegend, legendBasePt, meshColors, legendColors; plug-in component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
ladybug = Ladybug_Ladybug()  # -> Vviiiiiiiiiizzz; plug-in component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
