# Grasshopper definition 01_gridbased_analysis.gh (Grasshopper 0.9.76)
# plug-ins: Python Interpreter

# ---- group: geometry
brep = Brep([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])
radglassmaterial = HoneybeePlus_RadianceGlassMaterial(name="g_material", TVis="0.55")  # -> material; plug-in component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
preview = CustomPreview(Geometry=brep, Shader=ColourSwatch(SwatchColor=RGBA(65, 114, 255, 72)))
panel = Panel(radglassmaterial)
hbwinsrf = HoneybeePlus_HoneybeeWindowSurface(geo=brep, radMat=radglassmaterial)  # -> report, HBWinSrf; plug-in component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

# ---- group: geometry / opaque surfaces
brep_2 = Brep([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])
wires = BrepWireframe(Brep=brep_2, Density=-1)
preview_2 = CustomPreview(Geometry=wires, Shader=ColourSwatch(SwatchColor=RGB(0, 0, 0)))
hbsurface = HoneybeePlus_HoneybeeSurface(geo=brep_2)  # -> report, HBSrf; plug-in component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

# ---- group: geometry / context!
brep_3 = Brep([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])
debrep = DeconstructBrep(Brep=brep_3)  # -> flatten(Faces), Edges, Vertices
hbsurface_2 = HoneybeePlus_HoneybeeSurface(geo=debrep.Faces)  # -> report, HBSrf; plug-in component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

# ----
path = FilePath("C:\EnergyPlusV8-6-0\WeatherData\USA_IL_Chicago-OHare.Intl.AP.725300_TMY3.epw")
constructlocation = Ladybug_ConstructLocation(locationName="unknown_Location", latitude="36", longitude=0, timeZone=0, elevation=0)  # -> location; plug-in component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
brep_4 = Brep([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])
wea = HoneybeePlus_Wea(epwFile=path)  # -> wea; plug-in component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
gentestpts = Honeybee_GenerateTestPoints(testGeometry=brep_4, gridSize="1", distBaseSrf=Slider(0.762, range=0..1), moveTestMesh=True)  # -> readMe, simplify(testPoints), simplify(ptsVectors), simplify(facesArea), simplify(mesh); plug-in component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
wires_2 = BrepWireframe(Brep=brep_4, Density=-1)
panel_2 = Panel("""room_a
room_b""")
panel_3 = Panel("9")
panel_4 = Panel("21")
graft = GraftTree(Tree=panel_2, IncludeEmptyLists=True, IncludeNullItems=True)
climatebased = HoneybeePlus_ClimatebasedSky(wea=wea)  # -> sky; plug-in component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
ciesky = HoneybeePlus_CIEStandardSky(location=constructlocation, month=6, day=21, hour="16", skyType=0)  # -> sky; plug-in component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
analysisgrid = HoneybeePlus_AnalysisGrid(name=graft, testPoints=gentestpts.testPoints, ptsVectors=gentestpts.ptsVectors)  # -> analysisGrid; plug-in component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
number_slider = Slider(1, range=0..1)
panel_5 = Panel(climatebased)
flatten = FlattenTree(Tree=analysisgrid, Path="{0}")
panel_6 = Panel(flatten)
panel_7 = Panel(ciesky)
gridbasedrecipe = HoneybeePlus_GridBasedRecipe(sky=climatebased, analysisGrids=flatten, analysisType=0)  # -> analysisRecipe; plug-in component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

# ---- group: visualizeGeometry
python = PythonScript()  # -> geo; inputs HBObjs: list
# ---------- python: Python ----------
geo = (hbo.geometry for hbo in HBObjs if hasattr(hbo, 'geometry'))
# ---------- end python ----------

# ----
toggle = BooleanToggle(False)
panel_8 = Panel(gridbasedrecipe)
data = Data(flatten([hbsurface_2.HBSrf, hbsurface.HBSrf, hbwinsrf.HBWinSrf]))
runradiance = HoneybeePlus_RunRadianceAnalysis(analysisRecipe=gridbasedrecipe, HBObjects=data, folder="c:\ladybug", name="workshops", write=toggle, run=toggle)  # -> readMe, legendPar, results; plug-in component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
sensor = HoneybeePlus_SensorFromAnalysisGrid(analysisGrid=runradiance.results, index=0)  # -> position, sensor; plug-in component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
panel_9 = Panel(runradiance.results)

# ---- group: temporary solution until ladybug[+] is ready!
python_2 = PythonScript(x=runradiance.legendPar)  # -> a, b, c, d
# ---------- python_2: Python ----------
from System.Drawing import Color
if x:
    a = x.domain[0]
    b = x.domain[-1]
    c = 11
    d = (Color.FromArgb(1, c.r, c.g, c.b) for c in x.colors)
# ---------- end python_2 ----------

# ---- group: hourly values
python_3 = PythonScript(grid=runradiance.results)  # -> readMe, illuminance; inputs hoy: Int32
# ---------- python_3: Python ----------
if _grid:
    from ladybug.dt import DateTime
    
    hoy = _hoy_ or 12
    
    try:
        states = eval(blinds_state_)
    except:
        states = None
    
    if _grid.isResultsPointInTime:
        
        print('Data is only available for {}'.format(DateTime.fromHoy(_grid.hoys[0])))
        illuminance = (p.combinedValueById(_grid.hoys[0], states)[0] for p in _grid)
    else:
        illuminance = (p.combinedValueById(hoy, states)[0] for p in _grid)
# ---------- end python_3 ----------

# ----
item = ListItem(List=sensor.sensor, Index=0, Wrap=True)
python_4 = PythonScript(x=item)  # -> out, a
# ---------- python_4: Python ----------
print x._values
# ---------- end python_4 ----------
legendpar = Ladybug_LegendParameters(lowBound=python_2.a, highBound=python_2.b, numSegments=python_2.c, customColors=flatten(python_2.d))  # -> legendPar; plug-in component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
panel_10 = Panel(runradiance.readMe)
panel_11 = Panel(python_4.out)
flatten_2 = FlattenTree(Tree=python_3.illuminance, Path="{0}")
flatten_3 = FlattenTree(Tree=gentestpts.mesh, Path="{0}")
mjoin = MeshJoin(Meshes=flatten_3)
recolormesh = Ladybug_RecolorMesh(
    analysisResult=flatten_2,
    inputMesh=mjoin,
    legendPar=legendpar,
    analysisTitle="Point-in-time Analysis",
    legendTitle="lux")  # -> readMe, newMesh, newLegend, legendBasePt, meshColors, legendColors; plug-in component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
ladybug = Ladybug_Ladybug()  # -> Vviiiiiiiiiizzz; plug-in component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
