# Grasshopper definition 01_point_in_time_imagebased.gh (Grasshopper 1.0.7)
# plug-ins: Ironbug

# ---- group: context!
brep = Brep([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])
debrep = DeconstructBrep(Brep=brep)  # -> flatten(Faces), Edges, Vertices

# ----
# Point in time daylight simulation aka Image-based
# This is the same as image-based daylight simulation in honeybee.
txt = Text("https://www.energyplus.net/weather-download/north_and_central_america_wmo_region_4/USA/IL/USA_IL_Chicago-OHare.725300_TMY2/all")
# Room geometry except for the openings.
# Types and materials will be assigned
# based on normal direction.
# 
# These geometries are under ./scene/opaque
panel = Panel("0.55")
# Context
# Context is part of the scene that won't
# change for paramteric studies. We
# just write them to a file once and include
# them in the analysis. For multi-phase
# studies it will only be part of the scene
# for daylight matrix calculation.
# 
# If copyLocal is True the file will be copied
# to ./scene/extra
# 
# NOTE: You can always create the context
# using HBSurface similar to the rest of the
# scene. This method will save you time for
# iterative studies.
hbsurface = HoneybeePlus_HoneybeeSurface(geo=debrep.Faces)  # -> report, HB_srf; plug-in component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
downloadweather = LadybugPlus_DownloadWeather(weather_URL=txt)  # -> epw_file, stat_file, ddy_file; plug-in component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

# ---- group: opaque surfaces
brep_2 = Brep([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])
wires = BrepWireframe(Brep=brep_2, Density=-1)
preview = CustomPreview(Geometry=wires, Shader=ColourSwatch(SwatchColor=RGB(0, 0, 0)))
hbsurface_2 = HoneybeePlus_HoneybeeSurface(geo=brep_2)  # -> report, HB_srf; plug-in component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

# ----
crv = Curve(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)
# Use this component to create a view.
# In the next release we will add view by
# name component so you can create the
# view using the view name.
# 
# View will be created under ./view folder.
end = EndPoints(Curve=crv)  # -> Start, End
# Geometry Preparation
# Windows are added to the scene
# as normal windows. They will be grouped
# together with room geometries.
# check ./scene/glazing
brep_3 = Brep([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])
radglassmat = HoneybeePlus_RadianceGlassMaterial(name="g_material", t_vis=panel)  # -> material; plug-in component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
# Sky
path = FilePath(downloadweather.epw_file)
preview_2 = CustomPreview(Geometry=brep_3, Shader=ColourSwatch(SwatchColor=RGBA(65, 114, 255, 72)))
panel_2 = Panel("1000")
panel_3 = Panel("120")
panel_4 = Panel(radglassmat)
# View
importlocation = Ladybug_ImportLocation(epwFile=path)  # -> location; plug-in component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
# Use any of the sky components to
# generate the sky for the simulation.
# 
# Sky will be created under ./sky folder.
wea = HoneybeePlus_WEAFromEPW(epw_file=path)  # -> wea; plug-in component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
hbwinsrf = HoneybeePlus_HoneybeeWindowSurface(geo=brep_3, rad_mat=radglassmat)  # -> report, HB_win_srf; plug-in component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
vec2pt = Vector2Pt(PointA=end.Start, PointB=end.End, Unitize=False)  # -> Vector, Length
ciesky = HoneybeePlus_CIEStandardSky(location=importlocation, month=6, day=21, type=0)  # -> sky; plug-in component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
climatebased = HoneybeePlus_ClimatebasedSky(wea=wea)  # -> sky; plug-in component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
view = HoneybeePlus_View(
    name="indoor_view",
    v_location=end.Start,
    v_direction=vec2pt.Vector,
    v_up_vector=Point(0, 0, 1),
    view_type=0,
    h_view_angle=45,
    v_view_angle=45,
    x_resolution="2000",
    y_resolution="2000")  # -> view; plug-in component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
vdisex = VectorDisplayEx(Point=end.Start, Vector=vec2pt.Vector, Colour=RGB(0, 0, 0), Width=2)
data = Data(ciesky)
hbtorad = HoneybeePlus_WriteHBObjectsToRadiance(HB_objects=hbsurface.HB_srf, folder="c:\ladybug\context", file_name="context.rad", write=Toggle(True))  # -> rad_file; plug-in component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
radscene = HoneybeePlus_RadianceScene(rad_files=hbtorad, copy_local=True, overwrite=True)  # -> rad_scene; plug-in component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
# Recipe
imagebasedrecipe = HoneybeePlus_ImageBasedRecipe(sky=data, views=view, analysis_type=2)  # -> analysis_recipe; plug-in component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
# Run the simulation
panel_5 = Panel(imagebasedrecipe)
data_2 = Data(flatten([hbsurface_2.HB_srf, hbwinsrf.HB_win_srf]))
# Set write to True to save the files to
# the project folder. This gives you the
# option to check the files before running
# the simulation.
# 
# Once ready also set run to True and the
# component will run the study. The output
# will be the analysis grids or an image
# collection based on the analysis type.
# 
# Results will be stored under ./result
runradiance = HoneybeePlus_RunRadianceAnalysis(
    analysis_recipe=imagebasedrecipe,
    HB_objects=data_2,
    rad_scene=radscene,
    folder="c:\ladybug",
    name="hbp_sample_files",
    write=Toggle(False),
    run=Toggle(False))  # -> report, legend_par, outputs; plug-in component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
panel_6 = Panel(runradiance.report)
# Post process
# Result visualization
sethdrexposure = Honeybee_SetExposureForHDR(HDRFilePath=runradiance.outputs, exposure=Slider(0.5, range=0..1), render=Toggle(True))  # -> outputFilePath; plug-in component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
ladybug = Ladybug_Ladybug()  # -> Vviiiiiiiiiizzz; plug-in component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
honeybee = Honeybee_Honeybee()  # -> Vviiiiiiiiiizzz; plug-in component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
viewer = Ladybug_ImageViewer(ImagePath_=sethdrexposure, _scale_=Slider(1, range=0..10), DisableClickable=False, SaveImgWithCoords=False, scale=1)  # -> ImagePath, Colors, GIF
