# Grasshopper definition 02_daylight_factor_gridbased.gh (Grasshopper 1.0.7)

# Geometry Preparation
number_slider = Slider(0.762, range=0..1)
# Daylight factor simulation - grid-based
# Daylight factor
panel = Panel("1")

# ---- group: opaque surfaces
# Room geometry except for the openings.
# Types and materials will be assigned
# based on normal direction.
# 
# These geometries are under ./scene/opaque
brep = Brep([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])
wires = BrepWireframe(Brep=brep, Density=-1)
preview = CustomPreview(Geometry=wires, Shader=ColourSwatch(SwatchColor=RGB(0, 0, 0)))
hbsurface = HoneybeePlus_HoneybeeSurface(geo=brep)  # -> report, HB_srf; plug-in component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

# ----
# Generate test points
# You can use any other grasshopper
# components to generate these points.
brep_2 = Brep([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])
# Windows are added to the scene
# as normal windows. They will be grouped
# together with room geometries.
# check ./scene/glazing
brep_3 = Brep([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])
radglassmat = HoneybeePlus_RadianceGlassMaterial(name="g_material", t_vis="0.55")  # -> material; plug-in component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

# ---- group: context!
brep_4 = Brep([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])
debrep = DeconstructBrep(Brep=brep_4)  # -> flatten(Faces), Edges, Vertices

# ----
wires_2 = BrepWireframe(Brep=brep_2, Density=-1)
genpts = LBGeneratePointGrid(geometry=brep_2, grid_size=panel, dist_surface=number_slider)  # -> points, vectors, face_areas, mesh; plug-in component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
preview_2 = CustomPreview(Geometry=brep_3, Shader=ColourSwatch(SwatchColor=RGBA(65, 114, 255, 72)))
panel_2 = Panel(radglassmat)
hbwinsrf = HoneybeePlus_HoneybeeWindowSurface(geo=brep_3, rad_mat=radglassmat)  # -> report, HB_win_srf; plug-in component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
hbsurface_2 = HoneybeePlus_HoneybeeSurface(geo=debrep.Faces)  # -> report, HB_srf; plug-in component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
panel_3 = Panel("""room_a
room_b""")
graft = GraftTree(Tree=panel_3, IncludeEmptyLists=True, IncludeNullItems=True)
# Analysis Grid
analysisgrid = HoneybeePlus_AnalysisGrid(name=graft, test_points=genpts.points, pts_vectors=genpts.vectors)  # -> analysis_grid; plug-in component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
flatten = FlattenTree(Tree=analysisgrid, Path="{0}")
data = Data(flatten([hbsurface_2.HB_srf, hbsurface.HB_srf, hbwinsrf.HB_win_srf]))
# Recipe
dfrecipe = HoneybeePlus_DaylightFactorRecipe(analysis_grids=flatten)  # -> analysis_recipe; plug-in component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
toggle = BooleanToggle(False)
# Run the simulation
panel_4 = Panel(dfrecipe)
# Set write to True to save the files to
# the project folder. This gives you the
# option to check the files before running
# the simulation.
# 
# Once ready also set run to True and the
# component will run the study. The output
# will be the analysis grids or an image
# collection based on the analysis type.
# 
# Results will be stored under ./result
runradiance = HoneybeePlus_RunRadianceAnalysis(analysis_recipe=dfrecipe, HB_objects=data, folder="c:\ladybug", name="hbp_sample_file", write=toggle, run=toggle)  # -> report, legend_par, outputs; plug-in component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
# Post process
# Result visualization
# In case of grid-based analysis the result
# is only available for the single hour of
# the simulation.
python = GhPythonScript(legend_par=runradiance.legend_par, max="20")  # -> legend_par
# ---------- python: Python ----------
if _legend_par:
    if max_:
        _legend_par.max = max_
    
    legend_par = _legend_par
# ---------- end python ----------
hourlyvalues = HoneybeePlus_HourlyValues(analysis_grid=runradiance.outputs)  # -> report, values; plug-in component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
flatten_2 = FlattenTree(Tree=genpts.mesh, Path="{0}")
mjoin = MeshJoin(Meshes=flatten_2)
flatten_3 = FlattenTree(Tree=hourlyvalues.values, Path="{0}")
heatmap = LBSpatialHeatmap(values=flatten_3, mesh=mjoin, legend_par=python, legend_title="%", global_title="Daylight factor")  # -> mesh, legend, title, colors, legend_par; plug-in component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
