# Grasshopper definition 03_annual_daylight_analysis.gh (Grasshopper 0.9.76)
# plug-ins: Python Interpreter

path = FilePath("C:\EnergyPlusV8-6-0\WeatherData\USA_IL_Chicago-OHare.Intl.AP.725300_TMY3.epw")
brep = Brep([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])
panel = Panel("""9
10
11
12
13
14
15""")
number_slider = Slider(2, range=0..10)
wires = BrepWireframe(Brep=brep, Density=-1)
panel_2 = Panel(path)
importlocation = Ladybug_ImportLocation(epwFile=path)  # -> location; plug-in component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
gentestpts = Honeybee_GenerateTestPoints(testGeometry=brep, gridSize="1", distBaseSrf=Slider(0.762, range=0..1), moveTestMesh=True)  # -> readMe, simplify(testPoints), simplify(ptsVectors), simplify(facesArea), simplify(mesh); plug-in component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
wea = HoneybeePlus_Wea(epwFile=path)  # -> wea; plug-in component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
doy_hoy = Ladybug_DOY_HOY(days=1, months="6", hours=panel)  # -> HOY, DOY, date; plug-in component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

# ---- group: single skylight
brep_2 = Brep(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)

# ---- group: south_skylight
brep_3 = Brep(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)

# ---- group: north_skylight
brep_4 = Brep(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)

# ---- group: opaque surfaces
brep_5 = Brep([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])
wires_2 = BrepWireframe(Brep=brep_5, Density=-1)
preview = CustomPreview(Geometry=wires_2, Shader=ColourSwatch(SwatchColor=RGB(0, 0, 0)))
hbsurface = HoneybeePlus_HoneybeeSurface(geo=brep_5)  # -> report, HBSrf; plug-in component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

# ----
concat = Concatenate(FragmentA="g_material_", FragmentB="0.55")

# ---- group: side window with two states / materials
brep_6 = Brep(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)

# ---- group: side windows. they are static and will be grouped together as window surfaces
brep_7 = Brep([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])

# ----
preview_2 = CustomPreview(Geometry=[brep_4, brep_3, brep_2], Shader=ColourSwatch(SwatchColor=RGBA(221, 128, 94, 72)))

# ---- group: context!
brep_8 = Brep([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])
debrep = DeconstructBrep(Brep=brep_8)  # -> flatten(Faces), Edges, Vertices
hbsurface_2 = HoneybeePlus_HoneybeeSurface(geo=debrep.Faces)  # -> report, HBSrf; plug-in component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

# ----
panel_3 = Panel("""single_skylight
south_skylight
north_skylight""")
panel_4 = Panel("""room_a
room_b""")
radpargridbased = HoneybeePlus_RadianceParametersGridBased(complexity=0, recipeType=Slider(1, range=0..1))  # -> report, radPar, vmtxPar, dmtxPar, smtxPar; plug-in component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
pt = Point(gentestpts.testPoints)
radglassmaterial = HoneybeePlus_RadianceGlassMaterial(name=concat, tVis="0.55")  # -> material; plug-in component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
merge = Merge(Data1=brep_2, Data2=brep_3, Data3=brep_4)
preview_3 = CustomPreview(Geometry=brep_7, Shader=ColourSwatch(SwatchColor=RGBA(121, 230, 94, 72)))
hbsurface_3 = HoneybeePlus_HoneybeeSurface()  # -> report, HBSrf; plug-in component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
graft = GraftTree(Tree=panel_4, IncludeEmptyLists=True, IncludeNullItems=True)
panel_5 = Panel(radpargridbased.dmtxPar)
analysisgrid = HoneybeePlus_AnalysisGrid(testPoints=gentestpts.testPoints)  # -> analysisGrid; plug-in component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
hbwinsrf = HoneybeePlus_HoneybeeWindowSurface(geo=merge, names=panel_3)  # -> report, HBWinSrf; plug-in component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
hbwinsrf_2 = HoneybeePlus_HoneybeeWindowSurface(geo=brep_6, names="north_facing", radMat=radglassmaterial)  # -> report, HBWinSrf; plug-in component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
hbwinsrf_3 = HoneybeePlus_HoneybeeWindowSurface(geo=brep_7)  # -> report, HBWinSrf; plug-in component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
skyvector = HoneybeePlus_SkyVector(north=0, wea=wea, month=6, day=21, hour="10")  # -> skyVec; plug-in component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
skymatrix = HoneybeePlus_SkyMatrix(north=0, wea=wea, density=1)  # -> skymtx; plug-in component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
radpargridbased_2 = HoneybeePlus_RadianceParametersGridBased(complexity=0, recipeType=Slider(1, range=0..1))  # -> report, radPar, vmtxPar, dmtxPar, smtxPar; plug-in component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
radparimagebased = HoneybeePlus_RadianceParametersImageBased(complexity=0)  # -> report, radPar, vmtxPar, dmtxPar, smtxPar; plug-in component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
flatten = FlattenTree(Tree=analysisgrid, Path="{0}")
panel_6 = Panel(radpargridbased_2.dmtxPar)
python = PythonScript(x=skymatrix)  # -> out, a
# ---------- python: Python ----------
a = dir(x)
# ---------- end python ----------
toggle = BooleanToggle(True)
panel_7 = Panel(python.a)
dcoeffgbrecipe = HoneybeePlus_DCGridBasedDaylightRecipe(skymtx=skymatrix, analysisGrids=flatten, analysisType=0, reuseDmtx=True)  # -> analysisRecipe; plug-in component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
radiationrecipe = HoneybeePlus_AnnualRadiationRecipe(skymtx=skymatrix, analysisGrids=flatten, reuseDmtx=True)  # -> analysisRecipe; plug-in component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
data = Data(flatten([hbsurface.HBSrf, hbsurface_2.HBSrf, hbwinsrf_3.HBWinSrf, hbwinsrf_2.HBWinSrf, hbwinsrf.HBWinSrf]))
toggle_2 = BooleanToggle(False)
python_2 = PythonScript(x=radiationrecipe)  # -> out, a
# ---------- python_2: Python ----------
print x.simulationType
print x.skyMatrix.skyType
# ---------- end python_2 ----------
python_3 = PythonScript(x=dcoeffgbrecipe)  # -> out, a; same code as python_2
panel_8 = Panel(python_2.out)
panel_9 = Panel(python_3.out)
runradiance = HoneybeePlus_RunRadianceAnalysis(
    analysisRecipe=radiationrecipe,
    HBObjects=data,
    folder="c:\ladybug",
    name="annual_analysis",
    write=toggle_2,
    run=toggle_2)  # -> readMe, legendPar, results; plug-in component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
data_2 = Data()
panel_10 = Panel(runradiance.readMe)
item = ListItem(List=data_2, Index=0, Wrap=True)
sensor = HoneybeePlus_SensorFromAnalysisGrid(analysisGrid=runradiance.results, index=0)  # -> position, sensor; plug-in component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
sensor_2 = HoneybeePlus_SensorFromAnalysisGrid(analysisGrid=data_2, index=0)  # -> position, sensor; plug-in component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
python_4 = PythonScript(x=item)  # -> out, a
# ---------- python_4: Python ----------
a = x[0]
# ---------- end python_4 ----------
importepw = LadybugPlus_ImportEPW(epwFile=path)  # -> report, location, dryBulbTemperature, dewPointTemperature, relativeHumidity, windSpeed, windDirection, directNormalRadiation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; plug-in component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
python_5 = PythonScript(x=python_4.a)  # -> out, a
# ---------- python_5: Python ----------
a = x.values(None, 'scene', 'default')
# ---------- end python_5 ----------
panel_11 = Panel("""(0,)
(-1,)""")
item_2 = ListItem(List=sensor_2.sensor, Index=Slider(0, range=0..1), Wrap=True)
senhourlyvalues = HoneybeePlus_SensorHourlyValues(sensor=sensor.sensor)  # -> report, values; plug-in component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
larger = LargerThan(FirstNumber=python_5.a, SecondNumber=300)  # -> LargerThan, OrEqualTo
number_slider_2 = Slider(100, range=0..100)
dynblindschd = HoneybeePlus_DynamicBlindsSchedule(sensor=item_2, blindCombs=panel_11)  # -> report, blindStates, blindStIndex, illumTotal, illumDirect, success; plug-in component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
ma = MassAddition(Input=larger.OrEqualTo)  # -> Result, PartialResults
panel_12 = Panel(python_5.a)
lng = ListLength(List=python_5.a)

# ---- group: radiation
int = Integer([0, 0, 0, 0, 0, 0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])

# ---- group: illuminance
int_2 = Integer([0, 0, 0, 0, 0, 0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])

# ----
python_6 = PythonScript(x=importepw.globalHorizontalRadiation)  # -> out, a; inputs x: list
# ---------- python_6: Python ----------
a = (int(i) for i in x)
# ---------- end python_6 ----------
division = Division(A=ma.Result, B=lng)
panel_13 = Panel(importepw.globalHorizontalIlluminance)
panel_14 = Panel(division)
number_slider_3 = Slider(13, range=9..18)
number_slider_4 = Slider(10, range=0..10)
occschduleweek = HoneybeePlus_OccupancyScheduleFromWeek(defValue=1)  # -> schedule, values; plug-in component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
number_slider_5 = Slider(55, range=0..100)
number_slider_6 = Slider(50, range=0..100)
panel_15 = Panel("(-1, -1, -1, -1, 0)")
item_3 = ListItem(Index=0, Wrap=True)
occschdule = HoneybeePlus_OccupancySchedule()  # -> schedule; plug-in component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
panel_16 = Panel(importepw.globalHorizontalRadiation)
ase = HoneybeePlus_AnnualSolarExposure(analysisGrid=data_2, threshold=1000, targetHrs=250, targetArea=10)  # -> report, success, ASE, perArea, prblmPts, prblmHrs; plug-in component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
sda = HoneybeePlus_SpatialDaylightAutonomy(
    analysisGrid=data_2,
    blindStates=dynblindschd.blindStates,
    occSchedule=occschduleweek.schedule,
    threshold=300,
    targetArea="90")  # -> report, sDA, prblmHrs; plug-in component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
annualmetrics = HoneybeePlus_AnnualDaylightMetrics(analysisGrid=data_2, blindStates=dynblindschd.blindStates, occSchedule=occschduleweek.schedule)  # -> report, DA, CDA, UDI, UDILess, UDIMore; plug-in component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
doy_hoy_2 = Ladybug_DOY_HOY(days=1, months=number_slider_4, hours=number_slider_3)  # -> HOY, DOY, date; plug-in component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
panel_17 = Panel(int)
lng_2 = ListLength(List=sda.prblmHrs)
number_slider_7 = Slider(2, range=1..2)
number_slider_8 = Slider(0, range=0..10)
item_4 = ListItem(List=sda.prblmHrs, Index=0, Wrap=True)
division_2 = Division(A=lng_2, B="22")
panel_18 = Panel(sda.sDA)
panel_19 = Panel(item_4)
division_3 = Division(A=panel_13, B=panel_16)
graph = QuickGraph(division_3)

# ---- group: hourly values
hourlyvalues = HoneybeePlus_HourlyValues(analysisGrid=runradiance.results, hoy=doy_hoy_2.HOY)  # -> report, values; plug-in component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

# ----
maxvalue = HoneybeePlus_MaximumValue(analysisGrid=data_2)  # -> values; plug-in component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
cumvalue = HoneybeePlus_CumulativeValue(analysisGrid=data_2)  # -> report, values; plug-in component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
ladybug = Ladybug_Ladybug()  # -> Vviiiiiiiiiizzz; plug-in component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
senhourlyvalues_2 = HoneybeePlus_SensorHourlyValues(sensor=item_2, mode=Slider(2, range=0..2))  # -> report, values; plug-in component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
panel_20 = Panel("250")

# ---- group: temporary solution until ladybug[+] is ready!
python_7 = PythonScript(x=runradiance.legendPar)  # -> a, b, c, d
# ---------- python_7: Python ----------
from System.Drawing import Color
if x:
    a = x.domain[0]
    b = x.domain[-1]
    c = 11
    d = (Color.FromArgb(1, c.r, c.g, c.b) for c in x.colors)
# ---------- end python_7 ----------

# ----
ase_2 = HoneybeePlus_AnnualSolarExposure(threshold=1000, targetHrs=250, targetArea=10)  # -> report, success, perArea, prblmPts, prblmHrs; plug-in component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
panel_21 = Panel(maxvalue)
sunpath = Ladybug_SunPath(
    location=importlocation,
    hour=number_slider_3,
    day=21,
    month=number_slider_4,
    timeStep=1,
    sunPathScale="0.25",
    dailyOrAnnualSunPath=True)  # -> readMe, sunVectors, sunAltitudes, sunAzimuths, port, sunSpheresMesh, sunPathCrvs, compassCrvs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; plug-in component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
legendpar = Ladybug_LegendParameters(lowBound=python_7.a, numSegments=python_7.c, customColors=flatten(python_7.d))  # -> legendPar; plug-in component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
mjoin = MeshJoin(Meshes=flatten(gentestpts.mesh))
flatten_2 = FlattenTree(Tree=hourlyvalues.values, Path="{0}")
panel_22 = Panel(sunpath.sunAltitudes)
recolormesh = Ladybug_RecolorMesh(
    analysisResult=flatten_2,
    inputMesh=mjoin,
    legendPar=legendpar,
    analysisTitle="Annual Solar Exposure",
    legendTitle="hour")  # -> readMe, newMesh, newLegend, legendBasePt, meshColors, legendColors; plug-in component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
ladybug_2 = Ladybug_Ladybug()  # -> Vviiiiiiiiiizzz; plug-in component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
