# Grasshopper definition 03_daylight_coefficient_daylight_analysis.gh (Grasshopper 0.9.76)
# plug-ins: Python Interpreter

path = FilePath("C:\EnergyPlusV8-6-0\WeatherData\USA_IL_Chicago-OHare.Intl.AP.725300_TMY3.epw")
panel = Panel(path)
brep = Brep([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])
panel_2 = Panel("""9
10
11
12
13
14
15""")

# ---- group: Skylights will have only one state but we create a separate window group for each so we can study the effect of removing / adding each of them / south_skylight
brep_2 = Brep(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)

# ---- group: Skylights will have only one state but we create a separate window group for each so we can study the effect of removing / adding each of them / single skylight
brep_3 = Brep(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)

# ---- group: Skylights will have only one state but we create a separate window group for each so we can study the effect of removing / adding each of them / north_skylight
brep_4 = Brep(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)

# ----
concat = Concatenate(FragmentA="g_material_", FragmentB="0.25")
importepw = Ladybug_ImportEpw(epwFile=path)  # -> readMe, latitude, location, dryBulbTemperature, dewPointTemperature, relativeHumidity, windSpeed, windDirection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; plug-in component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
wires = BrepWireframe(Brep=brep, Density=-1)
importlocation = Ladybug_ImportLocation(epwFile=path)  # -> location; plug-in component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
gentestpts = Honeybee_GenerateTestPoints(testGeometry=brep, gridSize="1", distBaseSrf=Slider(0.762, range=0..1), moveTestMesh=True)  # -> readMe, simplify(testPoints), simplify(ptsVectors), simplify(facesArea), simplify(mesh); plug-in component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
wea = HoneybeePlus_Wea(epwFile=path)  # -> wea; plug-in component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
doy_hoy = Ladybug_DOY_HOY(days=1, months="6", hours=panel_2)  # -> HOY, DOY, date; plug-in component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
concat_2 = Concatenate(FragmentA="g_material_", FragmentB="0.55")
radglassmaterial = HoneybeePlus_RadianceGlassMaterial(name=concat, TVis="0.25")  # -> material; plug-in component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
preview = CustomPreview(Geometry=[brep_4, brep_2, brep_3], Shader=ColourSwatch(SwatchColor=RGBA(221, 128, 94, 72)))

# ---- group: opaque surfaces
brep_5 = Brep([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])
wires_2 = BrepWireframe(Brep=brep_5, Density=-1)
preview_2 = CustomPreview(Geometry=wires_2, Shader=ColourSwatch(SwatchColor=RGB(0, 0, 0)))
hbsurface = HoneybeePlus_HoneybeeSurface(geo=brep_5)  # -> report, HBSrf; plug-in component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

# ----
panel_3 = Panel("""single_skylight
south_skylight
north_skylight""")
merge = Merge(Data1=brep_3, Data2=brep_2, Data3=brep_4)

# ---- group: side window with two states / materials
brep_6 = Brep(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)

# ---- group: side windows. they are static and will be grouped together as window surfaces
brep_7 = Brep([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])

# ----
radglassmaterial_2 = HoneybeePlus_RadianceGlassMaterial(name=concat_2, TVis="0.55")  # -> material; plug-in component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
hbwingroupstate = HoneybeePlus_WindowGroupState(name="dark_glass_0.25", radMat=radglassmaterial)  # -> report, state; plug-in component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

# ---- group: context!
brep_8 = Brep([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])
debrep = DeconstructBrep(Brep=brep_8)  # -> flatten(Faces), Edges, Vertices
hbsurface_2 = HoneybeePlus_HoneybeeSurface(geo=debrep.Faces)  # -> report, HBSrf; plug-in component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

# ----
pt = Point(gentestpts.testPoints)
panel_4 = Panel("""room_a
room_b""")
preview_3 = CustomPreview(Geometry=brep_7, Shader=ColourSwatch(SwatchColor=RGBA(121, 230, 94, 72)))
graft = GraftTree(Tree=merge, IncludeEmptyLists=True, IncludeNullItems=True)
graft_2 = GraftTree(Tree=panel_3, IncludeEmptyLists=True, IncludeNullItems=True)
graft_3 = GraftTree(Tree=panel_4, IncludeEmptyLists=True, IncludeNullItems=True)
strnum = Ladybug_SeparateData(inputList=flatten(importepw.diffuseHorizontalRadiation))  # -> numbers, strings; plug-in component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
strnum_2 = Ladybug_SeparateData(inputList=flatten(importepw.directNormalRadiation))  # -> numbers, strings; plug-in component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
hbwingroup = HoneybeePlus_HoneybeeWindowGroup(geo=brep_6, name="north_facing", radMat=radglassmaterial_2, states=hbwingroupstate.state)  # -> report, HBWinGroup; plug-in component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
hbwingroup_2 = HoneybeePlus_HoneybeeWindowGroup(geo=graft, name=graft_2)  # -> report, HBWinGroup; plug-in component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
hbwinsrf = HoneybeePlus_HoneybeeWindowSurface(geo=brep_7)  # -> report, HBWinSrf; plug-in component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
analysisgrid = HoneybeePlus_AnalysisGrid(name=graft_3, testPoints=gentestpts.testPoints, ptsVectors=gentestpts.ptsVectors)  # -> analysisGrid; plug-in component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
skymatrix = HoneybeePlus_SkyMatrix(north=0, wea=wea, density=1)  # -> skymtx; plug-in component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
skyvector = HoneybeePlus_SkyVector(north=0, wea=wea, month=6, day=21, hour="10")  # -> skyVec; plug-in component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
number_slider = Slider(1, range=0..1)
series = Series(Start="7", Step=1, Count="9")
panel_5 = Panel(hbwingroup_2.HBWinGroup)
flatten = FlattenTree(Tree=analysisgrid, Path="{0}")
item = ListItem(List=strnum_2.numbers, Index=series, Wrap=True)
item_2 = ListItem(List=strnum.numbers, Index=series, Wrap=True)
dcoeffgbrecipe = HoneybeePlus_DCGridBasedDaylightRecipe(skyMTX=skymatrix, analysisGrids=flatten, analysisType=0, reuseDaylightMTX=Toggle(False))  # -> analysisRecipe; plug-in component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
panel_6 = Panel(importlocation)
diffuse = Panel(item_2)
direct = Panel(item)
toggle = BooleanToggle(False)
python = PythonScript()  # -> out, a; disabled
# ---------- python: Python ----------
import honeybee
#reload(honeybee.radiance.datatype)
reload(honeybee.radiance.recipe.recipeutil)
# ---------- end python ----------
data = Data(flatten([hbsurface.HBSrf, hbsurface_2.HBSrf, hbwingroup.HBWinGroup, hbwinsrf.HBWinSrf, hbwingroup_2.HBWinGroup]))
panel_7 = Panel(dcoeffgbrecipe)
runradiance = HoneybeePlus_RunRadianceAnalysis(analysisRecipe=dcoeffgbrecipe, HBObjects=data, folder="c:\ladybug", name="development", write=toggle, run=toggle)  # -> readMe, legendPar, results; plug-in component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
panel_8 = Panel(runradiance.readMe)
number_slider_2 = Slider(6, range=0..10)
number_slider_3 = Slider(14, range=9..18)
panel_9 = Panel("(-1, -1, -1, -1, 0)")
number_slider_4 = Slider(10000, range=0..10000)
panel_10 = Panel("100")
doy_hoy_2 = Ladybug_DOY_HOY(days=1, months=number_slider_2, hours=number_slider_3)  # -> HOY, DOY, date; plug-in component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

# ---- group: hourly values
python_2 = PythonScript(grid=runradiance.results, hoy=doy_hoy_2.HOY)  # -> illuminance; inputs hoy: Int32
# ---------- python_2: Python ----------
if _grid and _hoy:
    try:
        states = eval(blinds_state_)
    except:
        states = None
    illuminance = (p.combinedValueById(_hoy, states)[0] for p in _grid)
# ---------- end python_2 ----------

# ---- group: get daylight autonomy
python_3 = PythonScript(workingHours="9 To 17", threshold=300, minUsefulIllum=100, maxUsefulIllum=2000)  # -> DA, CDA, UDI, less, more; inputs results: list, threshold: Int32, minUsefulIllum: Int32, maxUsefulIllum: Int32
# ---------- python_3: Python ----------
if _results and _results[0]:
    stTime, endTime = _workingHours_
    _DA = [0] * len(_results[0])
    _CDA = [0] * len(_results[0])
    _UDI =  [0] * len(_results[0])
    _less =  [0] * len(_results[0])
    _more =  [0] * len(_results[0])

    nOfHours = 0
    for HOY, result in enumerate(_results):
        if not stTime <= HOY % 24 < endTime:
            continue
        nOfHours += 1
        for ptCount, ill in enumerate(result):
            _ill = float(ill)
            if _ill >= _threshold_:
                _DA[ptCount] += 1
                _CDA[ptCount] += 1
            else:
                _CDA[ptCount] += _ill /_threshold_
            
            if _ill < _minUsefulIllum_:
                _less[ptCount] += 1
            elif _ill > _maxUsefulIllum_:
                _more[ptCount] += 1
            else:
                _UDI[ptCount] += 1
    
    if nOfHours > 0:
        # divide values by the number of hours
        DA = (v / nOfHours * 100 for v in _DA)
        CDA = (v / nOfHours * 100 for v in _CDA)
        UDI = (v / nOfHours * 100 for v in _UDI)
        less = (v / nOfHours * 100 for v in _less)
        more = (v / nOfHours * 100 for v in _more)
# ---------- end python_3 ----------

# ----
sunpath = Ladybug_SunPath(
    location=importlocation,
    hour=number_slider_3,
    day=21,
    month=number_slider_2,
    timeStep=1,
    sunPathScale="0.25",
    dailyOrAnnualSunPath=True)  # -> readMe, sunVectors, sunAltitudes, sunAzimuths, port, sunSpheresMesh, sunPathCrvs, compassCrvs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; plug-in component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
ladybug = Ladybug_Ladybug()  # -> Vviiiiiiiiiizzz; plug-in component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

# ---- group: temporary solution until ladybug[+] is ready!
python_4 = PythonScript(x=runradiance.legendPar)  # -> a, b, c, d
# ---------- python_4: Python ----------
from System.Drawing import Color
if x:
    a = x.domain[0]
    b = x.domain[-1]
    c = 11
    d = (Color.FromArgb(1, c.r, c.g, c.b) for c in x.colors)
# ---------- end python_4 ----------

# ----
legendpar = Ladybug_LegendParameters(lowBound=python_4.a, highBound=python_4.b, numSegments=python_4.c, customColors=flatten(python_4.d))  # -> legendPar; plug-in component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
panel_11 = Panel(sunpath.sunAltitudes)
mjoin = MeshJoin(Meshes=flatten(gentestpts.mesh))
flatten_2 = FlattenTree(Tree=python_2, Path="{0}")
recolormesh = Ladybug_RecolorMesh(analysisResult=flatten_2, inputMesh=mjoin, legendPar=legendpar, analysisTitle="hourly illuminance", legendTitle="lux")  # -> readMe, newMesh, newLegend, legendBasePt, meshColors, legendColors; plug-in component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
ladybug_2 = Ladybug_Ladybug()  # -> Vviiiiiiiiiizzz; plug-in component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
