# Grasshopper definition 03_solaraccess_gridbased.gh (Grasshopper 0.9.76)
# plug-ins: Python Interpreter

series = Series(Start="1", Step=1, Count="12")
series_2 = Series(Start=0, Step=1, Count="24")
# Solar access aka sunlight hours simulation
# In honeybee[+], we renamed sunlight hours component to "solar access"
# to follow other available standards. We hope this note clarifies this potential
# sort of confusion.
path = FilePath("C:\EnergyPlusV8-6-0\WeatherData\USA_VA_Sterling-Washington.Dulles.Intl.AP.724030_TMY3.epw")
graft = GraftTree(Tree=series, IncludeEmptyLists=True, IncludeNullItems=True)
importloc = LadybugPlus_ImportLocation(epwFile=path)  # -> location; plug-in component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
hoy = LadybugPlus_CalculateHOY(month=graft, day=21, hour=series_2, minute=0)  # -> hoy, doy, date; plug-in component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
ladybug = Ladybug_Ladybug()  # -> Vviiiiiiiiiizzz; plug-in component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
flatten = FlattenTree(Tree=hoy.hoy, Path="{0}")
# Geometry Preparation
number_slider = Slider(0.762, range=0..1)
# Generate test points
# You can use any other grasshopper
# components to generate these points.
panel = Panel("1")
# Room geometry except for the openings.
# Types and materials will be assigned
# based on normal direction.
# 
# These geometries are under ./scene/opaque
panel_2 = Panel("wall")
sunpath = LadybugPlus_SunPath(
    north=0,
    location=importloc,
    hoys=flatten,
    centerPt=Point(0, 0, 0),
    scale=Slider(0.2, range=0..1),
    sunScale=1,
    annual=True)  # -> report, vectors, altitudes, azimuths, sunPts, analemma, compass, daily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; plug-in component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
radglassmaterial = HoneybeePlus_RadianceGlassMaterial(name="g_material", tVis=".6")  # -> material; plug-in component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
brep = Brep(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)
radopaquematerial = HoneybeePlus_RadianceOpaqueMaterial(name=panel_2, reflect=".55", spec=0, rough=0)  # -> material; plug-in component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
brep_2 = Brep(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)
gentestpts = Honeybee_GenerateTestPoints(testGeometry=brep, gridSize=panel, distBaseSrf=number_slider, moveTestMesh=True)  # -> readMe, simplify(testPoints), simplify(ptsVectors), simplify(facesArea), simplify(mesh); plug-in component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
panel_3 = Panel(radglassmaterial)
wires = BrepWireframe(Brep=brep, Density=-1)
preview = CustomPreview(Geometry=brep_2, Shader=ColourSwatch(SwatchColor=RGBA(211, 208, 255, 64)))
# Side window is added to the scene
# as normal windows. They will be grouped
# together with room geometries.
# check ./scene/glazing
wires_2 = BrepWireframe(Brep=brep_2, Density=-1)
brep_3 = Brep([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])
brep_4 = Brep(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)
panel_4 = Panel(radopaquematerial)
wires_3 = BrepWireframe(Brep=brep_3, Density=-1)
debrep = DeconstructBrep(Brep=brep_4)  # -> Faces, Edges, Vertices
hbwinsrf = HoneybeePlus_HoneybeeWindowSurface(geo=brep_2, names="glass_wall", radMat=radglassmaterial)  # -> report, HBWinSrf; plug-in component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
# Analysis Grid
analysisgrid = HoneybeePlus_AnalysisGrid(name="test_room", testPoints=gentestpts.testPoints, ptsVectors=gentestpts.ptsVectors)  # -> analysisGrid; plug-in component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
hbsurface = HoneybeePlus_HoneybeeSurface(geo=brep_3, radMat=radopaquematerial)  # -> report, HBSrf; plug-in component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
hbsurface_2 = HoneybeePlus_HoneybeeSurface(geo=debrep.Faces)  # -> report, HBSrf; plug-in component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
# Recipe
solaraccessrecipe = HoneybeePlus_SolarAccessRecipe(sunVectors=sunpath.vectors, hoys=sunpath.hoys, analysisGrids=analysisgrid)  # -> analysisRecipe; plug-in component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
data = Data(flatten([hbsurface_2.HBSrf, hbsurface.HBSrf, hbwinsrf.HBWinSrf]))
panel_5 = Panel(solaraccessrecipe)
# Run the simulation
# Set write to True to save the files to
# the project folder. This gives you the
# option to check the files before running
# the simulation.
# 
# Once ready also set run to True and the
# component will run the study. The output
# will be the analysis grids or an image
# collection based on the analysis type.
# 
# Results will be stored under ./result
runradiance = HoneybeePlus_RunRadianceAnalysis(
    analysisRecipe=solaraccessrecipe,
    HBObjects=data,
    folder="c:\ladybug",
    name="honeybee_005",
    write=Toggle(False),
    run=Toggle(True))  # -> report, legendPar, outputs; plug-in component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
panel_6 = Panel(runradiance.report)
item = ListItem(List=sunpath.hoys, Index=Slider(3, range=0..20), Wrap=True)
# Post process
# Result visualization
# You can get the cumulative values for
# all the hours or check the results for each
# hour separately.
# Cumulative results
cumvalue = HoneybeePlus_CumulativeValue(analysisGrid=runradiance.outputs)  # -> report, values; plug-in component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
# Hourly results
hourlyvalues = HoneybeePlus_HourlyValues(analysisGrid=runradiance.outputs, hoy=item)  # -> report, values; plug-in component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
num = Number(cumvalue.values)

# ---- group: temporary solution until ladybug[+] is ready!
python = PythonScript(x=runradiance.legendPar)  # -> a, b, c, d
# ---------- python: Python ----------
from System.Drawing import Color
if x:
    a = x.domain[0]
    b = x.domain[-1]
    c = 11
    d = (Color.FromArgb(1, c.r, c.g, c.b) for c in x.colors)
# ---------- end python ----------

# ----
legendpar = Ladybug_LegendParameters(lowBound=python.a, numSegments=python.c, customColors=flatten(python.d))  # -> legendPar; plug-in component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
recolormesh = Ladybug_RecolorMesh(analysisResult=num, inputMesh=gentestpts.mesh, legendPar=legendpar, analysisTitle="solar access", legendTitle="hours")  # -> readMe, newMesh, newLegend, legendBasePt, meshColors, legendColors; plug-in component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
