# Grasshopper definition 04_annual_daylight_gridbased.gh (Grasshopper 0.9.76)
# plug-ins: Python Interpreter

# ---- group: south_skylight
brep = Brep(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)

# ---- group: single skylight
brep_2 = Brep(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)

# ---- group: north_skylight
brep_3 = Brep(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)

# ----
concat = Concatenate(FragmentA="g_material_", FragmentB="0.55")
preview = CustomPreview(Geometry=[brep_3, brep, brep_2], Shader=ColourSwatch(SwatchColor=RGBA(221, 128, 94, 72)))

# ---- group: side window
brep_4 = Brep(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)

# ---- group: side windows. they are static and will be grouped together as window surfaces
# Windows
# In this example windows are grouped based
# on their material type. Note that you can't use
# windowgroups with the annual recipe.
# 
# Glazing geometries will be saved under ./scene/glazing
brep_5 = Brep([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])

# ----
radglassmaterial = HoneybeePlus_RadianceGlassMaterial(name=concat, tVis="0.55")  # -> material; plug-in component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
merge = Merge(Data1=brep_2, Data2=brep, Data3=brep_3)
preview_2 = CustomPreview(Geometry=brep_5, Shader=ColourSwatch(SwatchColor=RGBA(121, 230, 94, 72)))
hbwinsrf = HoneybeePlus_HoneybeeWindowSurface(geo=brep_5)  # -> report, HBWinSrf; plug-in component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
hbwinsrf_2 = HoneybeePlus_HoneybeeWindowSurface(geo=brep_4, names="north_facing", radMat=radglassmaterial)  # -> report, HBWinSrf; plug-in component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
concat_2 = Concatenate(FragmentA="g_material_", FragmentB="0.45")

# ---- group: context!
# Add context surfaces.
# These geometries are under ./scene/opaque
brep_6 = Brep([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])
debrep = DeconstructBrep(Brep=brep_6)  # -> flatten(Faces), Edges, Vertices
hbsurface = HoneybeePlus_HoneybeeSurface(geo=debrep.Faces)  # -> report, HBSrf; plug-in component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

# ---- group: opaque surfaces
brep_7 = Brep([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])
wires = BrepWireframe(Brep=brep_7, Density=-1)
# Geometry Preparation
preview_3 = CustomPreview(Geometry=wires, Shader=ColourSwatch(SwatchColor=RGB(0, 0, 0)))
# Room geometry except for the openings.
# Types and materials will be assigned
# based on normal direction.
# 
# These geometries are under ./scene/opaque
hbsurface_2 = HoneybeePlus_HoneybeeSurface(geo=brep_7)  # -> report, HBSrf; plug-in component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

# ----
radglassmaterial_2 = HoneybeePlus_RadianceGlassMaterial(name=concat_2, tVis="0.45")  # -> material; plug-in component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
# Generate test points
# You can use any other grasshopper
# components to generate these points.
panel = Panel("1")
brep_8 = Brep([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])
hbwinsrf_3 = HoneybeePlus_HoneybeeWindowSurface(geo=merge, radMat=radglassmaterial_2)  # -> report, HBWinSrf; plug-in component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
gentestpts = Honeybee_GenerateTestPoints(testGeometry=brep_8, gridSize=panel, distBaseSrf=Slider(0.762, range=0..1), moveTestMesh=True)  # -> readMe, simplify(testPoints), simplify(ptsVectors), simplify(facesArea), simplify(mesh); plug-in component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
wires_2 = BrepWireframe(Brep=brep_8, Density=-1)
# Annual daylight simulation; grid-based
# This sample file shows how to set up a grid-based annual daylight analysis.
# 
# NOTE: Annual daylight recipe is an special type of daylight coefficient recipe.
# The main difference is that in annual daylight recipe the hourly results are not
# loaded at the end of the analysis which makes it a better choice for cases with
# 1000s of test points.
path = FilePath("C:\EnergyPlusV8-6-0\WeatherData\USA_IL_Chicago-OHare.Intl.AP.725300_TMY3.epw")
wea = HoneybeePlus_Wea(epwFile=path)  # -> wea; plug-in component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
pt = Point(gentestpts.testPoints)
panel_2 = Panel("""9
10
11
12
13
14
15""")
doy_hoy = Ladybug_DOY_HOY(days=1, months="6", hours=panel_2)  # -> HOY, DOY, date; plug-in component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
skyvector = HoneybeePlus_SkyVector(north=0, wea=wea, month=6, day=21, hour="10")  # -> skyVec; plug-in component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
panel_3 = Panel("""room_a
room_b""")
graft = GraftTree(Tree=panel_3, IncludeEmptyLists=True, IncludeNullItems=True)
# Sky Matrix
# You can use hoys input for subannual simulation.
# Sky will be created under ./sky folder.
skymatrix = HoneybeePlus_SkyMatrix(north=0, wea=wea, density=1)  # -> skymtx; plug-in component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
# Analysis Grid
analysisgrid = HoneybeePlus_AnalysisGrid(name=graft, testPoints=gentestpts.testPoints, ptsVectors=gentestpts.ptsVectors)  # -> analysisGrid; plug-in component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
data = Data(flatten([hbsurface_2.HBSrf, hbsurface.HBSrf, hbwinsrf.HBWinSrf, hbwinsrf_2.HBWinSrf, hbwinsrf_3.HBWinSrf]))
toggle = BooleanToggle(True)
flatten = FlattenTree(Tree=analysisgrid, Path="{0}")
# Recipe
annualdlrecipe = HoneybeePlus_AnnualDaylightRecipe(skymtx=skymatrix, analysisGrids=flatten, analysisType=0, reuseDmtx=False)  # -> analysisRecipe; plug-in component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
panel_4 = Panel(annualdlrecipe)
# Run the simulation
# Set write to True to save the files to
# the project folder. This gives you the
# option to check the files before running
# the simulation.
# 
# Once ready also set run to True and the
# component will run the study. The output
# will be the analysis grids or an image
# collection based on the analysis type.
# 
# Results will be stored under ./result
runradiance = HoneybeePlus_RunRadianceAnalysis(
    analysisRecipe=annualdlrecipe,
    HBObjects=data,
    folder="c:\ladybug",
    name="honeybee_005",
    write=Toggle(False),
    run=Toggle(False))  # -> report, legendPar, outputs; plug-in component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
panel_5 = Panel(runradiance.report)
panel_6 = Panel("""8
18""")
# IES LM-83-12 analysis hours
panel_7 = Panel("-1")
occschduleweek = HoneybeePlus_OccupancyScheduleFromWeek(occHours=panel_6, offHours=panel_7, weekend="-1", defValue=1)  # -> schedule, values; plug-in component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
panel_8 = Panel(occschduleweek.schedule)
annualmetrics = HoneybeePlus_AnnualDaylightMetrics(analysisGrid=runradiance.outputs)  # -> report, DA, CDA, UDI, UDILess, UDIMore, legendPar; plug-in component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
# Result visualization
# Annual metrics
# Use any of the three components to calculate
# sDA, ASE, DA, CDA, UDI, etc.
ase = HoneybeePlus_AnnualSunlightExposure(analysisGrid=runradiance.outputs, threshold=1000, targetHrs=250, targetArea=10)  # -> report, success, ASE, perArea, prblmPts, prblmHrs, legendPar; plug-in component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
# NOTE:
# The blinds are not considered
# in this calculation unless you
# provide them using blindStates_.
sda = HoneybeePlus_SpatialDaylightAutonomy(analysisGrid=runradiance.outputs, occSchedule=occschduleweek.schedule, threshold=300, targetDA=50)  # -> report, sDA, DA, prblmPts; plug-in component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
panel_9 = Panel(annualmetrics.DA)
panel_10 = Panel(sda.sDA)
item = ListItem(List=ase.legendPar, Index=0, Wrap=True)

# ---- group: temporary solution until ladybug[+] is ready!
python = PythonScript(x=item)  # -> a, b, c, d
# ---------- python: Python ----------
from System.Drawing import Color
if x:
    a = x.domain[0]
    b = x.domain[-1]
    c = 11
    d = (Color.FromArgb(1, c.r, c.g, c.b) for c in x.colors)
# ---------- end python ----------

# ----
legendpar = Ladybug_LegendParameters(lowBound=python.a, highBound=python.b, numSegments=python.c, customColors=flatten(python.d))  # -> legendPar; plug-in component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
mjoin = MeshJoin(Meshes=flatten(gentestpts.mesh))
flatten_2 = FlattenTree(Tree=ase.ASE, Path="{0}")
recolormesh = Ladybug_RecolorMesh(analysisResult=flatten_2, inputMesh=mjoin, legendPar=legendpar, analysisTitle="ASE", legendTitle="hours")  # -> readMe, newMesh, newLegend, legendBasePt, meshColors, legendColors; plug-in component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
ladybug = Ladybug_Ladybug()  # -> Vviiiiiiiiiizzz; plug-in component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
