# Grasshopper definition 04_daylight_coefficient_daylight_analysis_Image.gh (Grasshopper 0.9.76)
# plug-ins: Python Interpreter, Embryo, Human

# ---- group: Skylights will have only one state but we create a separate window group for each so we can study the effect of removing / adding each of them / single skylight
brep = Brep(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)

# ---- group: Skylights will have only one state but we create a separate window group for each so we can study the effect of removing / adding each of them / south_skylight
brep_2 = Brep(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)

# ---- group: Skylights will have only one state but we create a separate window group for each so we can study the effect of removing / adding each of them / north_skylight
brep_3 = Brep(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)

# ----
concat = Concatenate(FragmentA="g_material_", FragmentB="0.25")
path = FilePath("C:\EnergyPlusV8-6-0\WeatherData\USA_IL_Chicago-OHare.Intl.AP.725300_TMY3.epw")
concat_2 = Concatenate(FragmentA="g_material_", FragmentB="0.55")
preview = CustomPreview(Geometry=[brep_3, brep_2, brep], Shader=ColourSwatch(SwatchColor=RGBA(221, 128, 94, 72)))
radglassmaterial = HoneybeePlus_RadianceGlassMaterial(name=concat, tVis="0.25")  # -> material; plug-in component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
panel = Panel("""single_skylight
south_skylight
north_skylight""")
panel_2 = Panel("""9
10
11
12
13
14
15""")
merge = Merge(Data1=brep)
panel_3 = Panel(path)

# ---- group: side window with two states / materials
brep_4 = Brep(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)

# ---- group: side windows. they are static and will be grouped together as window surfaces
brep_5 = Brep([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])

# ----
radglassmaterial_2 = HoneybeePlus_RadianceGlassMaterial(name=concat_2, tVis="0.55")  # -> material; plug-in component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

# ---- group: context!
brep_6 = Brep([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])
debrep = DeconstructBrep(Brep=brep_6)  # -> flatten(Faces), Edges, Vertices
hbsurface = HoneybeePlus_HoneybeeSurface(geo=debrep.Faces)  # -> report, HBSrf; plug-in component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

# ----
wea = HoneybeePlus_Wea(epwFile=path)  # -> wea; plug-in component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
doy_hoy = Ladybug_DOY_HOY(days=1, months="6", hours=panel_2)  # -> HOY, DOY, date; plug-in component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
item = ListItem(List=panel, Index=0, Wrap=True)
pt = Point(Point(1, 1, 2))
pt_2 = Point(Point(2.761757981, 3.184085208, 2.438065029))
hbwingroupstate = HoneybeePlus_WindowGroupState(name="dark_glass_0.25", radMat=radglassmaterial)  # -> report, state; plug-in component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
graft = GraftTree(Tree=merge, IncludeEmptyLists=True, IncludeNullItems=True)
preview_2 = CustomPreview(Geometry=brep_5, Shader=ColourSwatch(SwatchColor=RGBA(121, 230, 94, 72)))
list = ItemSelector(brep_5, {"Trimmed Surface", "Trimmed Surface", "Trimmed Surface"}, selected="Trimmed Surface")
graft_2 = GraftTree(Tree=item, IncludeEmptyLists=True, IncludeNullItems=True)
ln = Line(StartPoint=pt, EndPoint=pt_2)
vec = Vector(ln)
hbwingroup = HoneybeePlus_HoneybeeWindowGroup(geo=graft, name=graft_2)  # -> report, HBWinGroup; plug-in component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
hbwingroup_2 = HoneybeePlus_HoneybeeWindowGroup(geo=brep_4, name="north_facing", radMat=radglassmaterial_2, states=hbwingroupstate.state)  # -> report, HBWinGroup; plug-in component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
hbwinsrf = HoneybeePlus_HoneybeeWindowSurface(geo=[list, brep_4])  # -> report, HBWinSrf; plug-in component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
view = HoneybeePlus_View(
    name="inside_NE",
    vLocation=pt,
    vDirection=vec,
    vUpVector=Point(0, 0, 1),
    viewType=0,
    hViewAngle="60",
    vViewAngle=45,
    xResolution="250",
    yResolution="250")  # -> view; plug-in component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
panel_4 = Panel(hbwingroup.HBWinGroup)
skymatrix = HoneybeePlus_SkyMatrix(north=0, wea=wea, density=1, hoys=doy_hoy.HOY)  # -> skymtx; plug-in component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
skyvector = HoneybeePlus_SkyVector(north=0, wea=wea, month=6, day=21, hour="10")  # -> skyVec; plug-in component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
dcoeffgbrecipe = HoneybeePlus_DCImageBasedDaylightRecipe(skymtx=skymatrix, views=view, analysisType=2, reuseDmtx=Toggle(False))  # -> analysisRecipe; plug-in component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
python = PythonScript()  # -> out, a; disabled
# ---------- python: Python ----------
import honeybee
import ladybug

reload(ladybug.sunpath)
reload(honeybee.radiance.sky.sunmatrix)
# ---------- end python ----------
python_2 = PythonScript()  # -> out, a; disabled
# ---------- python_2: Python ----------
import honeybee
reload(honeybee.radiance.command.rcontrib)
reload(honeybee.radiance.recipe.daylightcoeff.imagebased)
# ---------- end python_2 ----------
ladybug = Ladybug_Ladybug()  # -> Vviiiiiiiiiizzz; plug-in component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
honeybee = Honeybee_Honeybee()  # -> Vviiiiiiiiiizzz; plug-in component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
number_slider = Slider(10000, range=0..10000)
panel_5 = Panel("100")
panel_6 = Panel("9 To 17")
hdr_tif = Honeybee_ConvertHDRToTIF(adjustExposure=Toggle(True))  # -> TIFFFilePath; plug-in component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
falsecolor = Honeybee_FalseColor(contourBands=False, maskThreshold=0.1, useAlterColors=False, render=Toggle(False))  # -> outputFilePath; plug-in component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
item_2 = ListItem(List=hdr_tif, Index=Slider(6, range=0..6), Wrap=True)
image = ImageFromPath(P=item_2, S=Slider(1, range=0..1))

# ---- group: opaque surfaces
brep_7 = Brep([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])
wires = BrepWireframe(Brep=brep_7, Density=-1)
preview_3 = CustomPreview(Geometry=wires, Shader=ColourSwatch(SwatchColor=RGB(0, 0, 0)))

# ----
list_2 = ItemSelector(
    brep_7,
    {"Trimmed Surface", "Untrimmed Surface", "Untrimmed Surface", "Untrimmed Surface", "Untrimmed Surface", "Trimmed Surface", "Trimmed Surface", "Untrimmed Surface", "Untrimmed Surface", "Trimmed Surface", "Untrimmed Surface", "Trimmed Surface"}, selected=["Trimmed Surface", "Untrimmed Surface", "Untrimmed Surface", "Untrimmed Surface", "Untrimmed Surface", "Trimmed Surface"])

# ---- group: opaque surfaces (continued)
hbsurface_2 = HoneybeePlus_HoneybeeSurface(geo=list_2)  # -> report, HBSrf; plug-in component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

# ----
data = Data(flatten([hbsurface_2.HBSrf, hbsurface.HBSrf, hbwinsrf.HBWinSrf]))
runradiance = HoneybeePlus_RunRadianceAnalysis(analysisRecipe=dcoeffgbrecipe, HBObjects=data, folder="c:\ladybug", name="image_based", write=Toggle(True))  # -> report, legendPar, outputs; plug-in component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
panel_7 = Panel(runradiance.report)
