# Grasshopper definition 05_annual_radiation_gridbased.gh (Grasshopper 0.9.76)
# plug-ins: Python Interpreter

# Generate test points
# You can use any other grasshopper
# components to generate these points.
panel = Panel("1")

# ---- group: context!
# Add context surfaces.
# These geometries are under ./scene/opaque
brep = Brep([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])
debrep = DeconstructBrep(Brep=brep)  # -> flatten(Faces), Edges, Vertices
hbsurface = HoneybeePlus_HoneybeeSurface(geo=debrep.Faces)  # -> report, HBSrf; plug-in component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

# ----
brep_2 = Brep(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)
# Geometry Preparation
wires = BrepWireframe(Brep=brep, Density=-1)
wires_2 = BrepWireframe(Brep=brep_2, Density=-1)
gentestpts = Honeybee_GenerateTestPoints(testGeometry=brep_2, gridSize=panel, distBaseSrf="0.01", moveTestMesh=True)  # -> readMe, simplify(testPoints), simplify(ptsVectors), simplify(facesArea), simplify(mesh); plug-in component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
# Annual radiation simulation; grid-based
# This sample file shows how to set up a grid-based annual radiation analysis.
# 
# NOTE: Annual radiation recipe is an special type of daylight coefficient recipe.
path = FilePath("C:\EnergyPlusV8-6-0\WeatherData\USA_IL_Chicago-OHare.Intl.AP.725300_TMY3.epw")
wea = HoneybeePlus_Wea(epwFile=path)  # -> wea; plug-in component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
pt = Point(gentestpts.testPoints)
panel_2 = Panel("""9
10
11
12
13
14
15""")
doy_hoy = Ladybug_DOY_HOY(days=1, months="6", hours=panel_2)  # -> HOY, DOY, date; plug-in component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
skyvector = HoneybeePlus_SkyVector(north=0, wea=wea, month=6, day=21, hour="10")  # -> skyVec; plug-in component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
graft = GraftTree(Tree="pv_panel", IncludeEmptyLists=True, IncludeNullItems=True)
# Sky Matrix
# You can use hoys input for subannual simulation.
# Sky will be created under ./sky folder.
skymatrix = HoneybeePlus_SkyMatrix(north=0, wea=wea, density=1)  # -> skymtx; plug-in component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
# Analysis Grid
analysisgrid = HoneybeePlus_AnalysisGrid(name=graft, testPoints=gentestpts.testPoints, ptsVectors=gentestpts.ptsVectors)  # -> analysisGrid; plug-in component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
data = Data(flatten(hbsurface.HBSrf))
flatten = FlattenTree(Tree=analysisgrid, Path="{0}")
# Recipe
radiationrecipe = HoneybeePlus_AnnualRadiationRecipe(skymtx=skymatrix, analysisGrids=flatten, reuseDmtx=Toggle(False))  # -> analysisRecipe; plug-in component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
panel_3 = Panel(radiationrecipe)
python = PythonScript(x=radiationrecipe)  # -> out, a
# ---------- python: Python ----------
print x.subFolder
# ---------- end python ----------
# Run the simulation
# Set write to True to save the files to
# the project folder. This gives you the
# option to check the files before running
# the simulation.
# 
# Once ready also set run to True and the
# component will run the study. The output
# will be the analysis grids or an image
# collection based on the analysis type.
# 
# Results will be stored under ./result
runradiance = HoneybeePlus_RunRadianceAnalysis(
    analysisRecipe=radiationrecipe,
    HBObjects=data,
    folder="c:\ladybug",
    name="sample_files",
    write=Toggle(False),
    run=Toggle(False))  # -> report, legendPar, outputs; plug-in component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
panel_4 = Panel(runradiance.report)
panel_5 = Panel("""1
6""")
mode = Slider(1, range=1..2)
sensor = HoneybeePlus_SensorFromAnalysisGrid(analysisGrid=runradiance.outputs, index=panel_5)  # -> position, sensor; plug-in component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
# Result visualization
# Cumulative results
cumvalue = HoneybeePlus_CumulativeValue(analysisGrid=runradiance.outputs)  # -> report, values; plug-in component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
# Hourly results
senhourlyvalues = HoneybeePlus_SensorHourlyValues(sensor=sensor.sensor)  # -> report, values; plug-in component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
graph = QuickGraph(senhourlyvalues.values)
item = ListItem(List=runradiance.legendPar, Index=0, Wrap=True)

# ---- group: temporary solution until ladybug[+] is ready!
python_2 = PythonScript(x=item)  # -> a, b, c, d
# ---------- python_2: Python ----------
from System.Drawing import Color
if x:
    a = x.domain[0]
    b = x.domain[-1]
    c = 11
    d = (Color.FromArgb(1, c.r, c.g, c.b) for c in x.colors)
# ---------- end python_2 ----------

# ----
legendpar = Ladybug_LegendParameters(numSegments=python_2.c, customColors=flatten(python_2.d))  # -> legendPar; plug-in component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
mjoin = MeshJoin(Meshes=flatten(gentestpts.mesh))
flatten_2 = FlattenTree(Tree=cumvalue.values, Path="{0}")
recolormesh = Ladybug_RecolorMesh(analysisResult=flatten_2, inputMesh=mjoin, legendPar=legendpar, analysisTitle="ASE", legendTitle="hours")  # -> readMe, newMesh, newLegend, legendBasePt, meshColors, legendColors; plug-in component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
ladybug = Ladybug_Ladybug()  # -> Vviiiiiiiiiizzz; plug-in component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
