# Grasshopper definition 08_three_phase_I_gridbased.gh (Grasshopper 1.0.7)

# Update the path to the correct folder on
# your machine.
python = GhPythonScript()  # -> a
# ---------- python: Python ----------
import os
a = os.path.dirname(ghenv.Component.OnPingDocument().FilePath) + r'\xmls\\'
# ---------- end python ----------
panel = Panel(python)
concat = Concatenate(FragmentA=panel, FragmentB="clear.xml")
concat_2 = Concatenate(FragmentA=panel, FragmentB="diffuse50.xml")
merge = Merge(Data1=concat, Data2=concat_2)

# ---- group: context!
brep = Brep([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])
panel_2 = Panel("6")

# ----
# Window Groups
# We are adding two window groups for
# this study. The skylight is its own window group
# which is not dynamic but we're interested
# to study its contribution separately.
# South window is the other window group
# which has two states: 1. clear, 2. diffuse50
# 
# Ensure that window groups are facing outwards.
# Honeybee flips the surfaces for view
# matrix calculation internally.
# 
# Window groups are under ./scene/wgroup
radbsdfmat = HoneybeePlus_RadianceBSDFMaterial(xmlfile=merge, up_vec=Vector(0.01, 0.01, 1), thickness=0)  # -> material; plug-in component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
# Context is part of the scene that won't
# change for paramteric studies. We
# just write them to a file once and include
# them in the analysis. For multi-phase
# studies it will only be part of the scene
# for daylight matrix calculation.
# 
# If copyLocal is True the file will be copied
# to ./scene/extra
# 
# NOTE: You can always create the context
# using HBSurface similar to the rest of the
# scene. This method will save you time for
# iterative studies.
# Context
hbsurface = HoneybeePlus_HoneybeeSurface(geo=brep, type=panel_2)  # -> report, HB_srf; plug-in component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
# Three phase daylight simulation example
# If this is the first time you're hearing about 3-phase simulation then first check this link:
# 
# The Three-Phase Method for Simulating Complex  Fenestration with Radiance by A McNeil, LBNL
# https://www.radiance-online.org/learning/tutorials/Tutorial-ThreePhaseMethod.pdf
txt = Text("https://www.energyplus.net/weather-download/north_and_central_america_wmo_region_4/USA/IL/USA_IL_Chicago-OHare.725300_TMY2/all")
# Geometry Preparation
number_slider = Slider(0.762, range=0..1)
item = ListItem(List=radbsdfmat, Index=0, Wrap=True)  # -> Item, Item1
downloadepw = LBDownloadWeather(weather_URL=txt)  # -> epw_file, stat_file, ddy_file; plug-in component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
# Generate test points
# You can use any other grasshopper
# components to generate these points.
brep_2 = Brep(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)
# Room geometry except for the openings.
# Types and materials will be assigned
# based on normal direction.
# 
# These geometries are under ./scene/opaque
brep_3 = Brep([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])
genpts = LBGeneratePointGrid(geometry=brep_2, grid_size="1", dist_surface=number_slider)  # -> points, vectors, face_areas, mesh; plug-in component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

# ---- group: weather file
path = FilePath(downloadepw.epw_file)

# ----
# Side windows are added to the scene
# as normal windows. They will be grouped
# together with room geometries.
# check ./scene/glazing
wires = BrepWireframe(Brep=brep_3, Density=-1)
brep_4 = Brep(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)
wingroupstate = HoneybeePlus_WindowGroupState(name="diffuse", rad_mat=item.Item1)  # -> report, state; plug-in component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
wea = HoneybeePlus_WEAFromEPW(epw_file=path)  # -> wea; plug-in component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
brep_5 = Brep([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])
preview = CustomPreview(Geometry=wires, Shader=ColourSwatch(SwatchColor=RGB(0, 0, 0)))
brep_6 = Brep(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)
hbwingroup = HoneybeePlus_HoneybeeWindowGroup(geo=brep_6, name="skylight", rad_mat=item.Item)  # -> report, HB_win_group; plug-in component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
hbwinsrf = HoneybeePlus_HoneybeeWindowSurface(geo=brep_5, names="side_window")  # -> report, HB_win_srf; plug-in component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
hbwingroup_2 = HoneybeePlus_HoneybeeWindowGroup(geo=brep_4, name="south_window", rad_mat=item.Item, states=wingroupstate.state)  # -> report, HB_win_group; plug-in component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
hbsurface_2 = HoneybeePlus_HoneybeeSurface(geo=brep_3, names="room_surface")  # -> report, HB_srf; plug-in component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
# Sky Matrix
# You can use hoys input for subannual simulation.
# Sky will be created under ./sky folder.
skymatrix = HoneybeePlus_SkyMatrix(north=0, wea=wea, density=1)  # -> skymtx; plug-in component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
hbtorad = HoneybeePlus_WriteHBObjectsToRadiance(HB_objects=hbsurface.HB_srf, folder="c:\ladybug\sample_files\context", file_name="context.rad", write=Toggle(True))  # -> rad_file; plug-in component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
# Analysis Grid
analysisgrid = HoneybeePlus_AnalysisGrid(name="room_w_skylight", test_points=genpts.points, pts_vectors=genpts.vectors)  # -> analysis_grid; plug-in component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
radscene = HoneybeePlus_RadianceScene(rad_files=hbtorad, copy_local=True, overwrite=True)  # -> rad_scene; plug-in component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
# Recipe
threephasegbrecipe = HoneybeePlus_GridBasedThreePhaseDaylightRecipe(skymtx=skymatrix, analysis_grids=analysisgrid, analysis_type=0, reuse_vmtx=False, reuse_dmtx=False)  # -> analysis_recipe; plug-in component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
# Run the simulation
data = Data(flatten([hbsurface_2.HB_srf, hbwingroup.HB_win_group, hbwingroup_2.HB_win_group, hbwinsrf.HB_win_srf]))
# Set write to True to save the files to
# the project folder. This gives you the
# option to check the files before running
# the simulation.
# 
# Once ready also set run to True and the
# component will run the study. The output
# will be the analysis grids or an image
# collection based on the analysis type.
# 
# Results will be stored under ./result
runradiance = HoneybeePlus_RunRadianceAnalysis(
    analysis_recipe=threephasegbrecipe,
    HB_objects=data,
    rad_scene=radscene,
    folder="c:\ladybug",
    name="hbp_sample_files",
    write=Toggle(False),
    run=Toggle(False))  # -> report, legend_par, outputs; plug-in component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
panel_3 = Panel(runradiance.report)
item_2 = ListItem(List=runradiance.legend_par, Index=0, Wrap=True)
# Result visualization
# This is an example file and so I'm showing
# different types of result visulaization inside
# the same file.
# 
# You most likely don't want to do all of
# this in a single file. Chek them from the top to bottom
mesh = Mesh(genpts.mesh)
data_2 = Data(runradiance.outputs)
panel_4 = Panel(data_2)
hoy = LBCalculateHOY(month=Slider(9, range=1..12), day=Slider(1, range=1..30), hour=Slider(17, range=9..18))  # -> flatten(hoy), flatten(doy), flatten(date); plug-in component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
# 1. Hourly results
# This is the simplest way of visualizing the results.
# You can load the results for each hour during the year. Try to change the sliders
# for day, month and hour, You can also change the state of each light source
# by changing the blindStates input. Try the 3 cases and see how it changes the results.
ladybug = Ladybug_Ladybug()  # -> Vviiiiiiiiiizzz; plug-in component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

# ---- group: change south window to diffuse
panel_5 = Panel("(0,1,0)")

# ---- group: remove the sky light
panel_6 = Panel("(0,0,-1)")

# ---- group: remove the south window and the skylight
panel_7 = Panel("(0,-1,-1)")

# ----
# 3. Annual metrics
# Check next example file for annual metrics.
# If you already run the analysis here the
# same results will be loaded!
panel_8 = Panel("""South window contribution
Side windows contribution
Skylight contribution""")
panel_9 = Panel("""-1, 0, -1
0, -1, -1
-1, -1, 0 """)
hourlyvalues = HoneybeePlus_HourlyValues(analysis_grid=data_2, hoy=hoy.hoy)  # -> report, values; plug-in component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
panel_10 = Panel(hourlyvalues.report)
# 2. Hourly results break-down
# This is the same as number 1.
# 
# The only difference is we're breaking down there results for 3 different blindStates
# and show them all together.  This will help us to understand how much every
# light source is contributing to the room.
hourlyvalues_2 = HoneybeePlus_HourlyValues(analysis_grid=data_2, hoy=hoy.hoy, blind_state=panel_9)  # -> report, values; plug-in component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
graft = GraftTree(Tree=panel_8, IncludeEmptyLists=True, IncludeNullItems=True)
heatmap = LBSpatialHeatmap(values=hourlyvalues.values, mesh=mesh, legend_par=item_2, legend_title="lux", global_title="Total illuminance level")  # -> mesh, legend, title, colors, legend_par; plug-in component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
panel_11 = Panel(hourlyvalues_2.report)
concat_3 = Concatenate(FragmentA=graft, FragmentB=hoy.date)
heatmap_2 = LBSpatialHeatmap(values=hourlyvalues_2.values, mesh=mesh, legend_par=item_2, legend_title="lux", global_title=concat_3)  # -> mesh, legend, title, colors, legend_par; plug-in component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
panel_12 = Panel(heatmap_2.legend_par)
# Move the graphs around!
panel_13 = Panel("""25
25
40""")
panel_14 = Panel("""8
-10
8""")
vec = VectorXYZ(XComponent=panel_13, YComponent=panel_14, ZComponent=0)  # -> graft(Vector), Length
move = Move(Geometry=heatmap_2.legend, Motion=vec.Vector)  # -> Geometry, Transform
move_2 = Move(Geometry=heatmap_2.title, Motion=vec.Vector)  # -> Geometry, Transform
move_3 = Move(Geometry=heatmap_2.mesh, Motion=vec.Vector)  # -> Geometry, Transform
