# Grasshopper definition 09_three_phase_II_gridbased.gh (Grasshopper 1.0.7)

python = GhPythonScript()  # -> a
# ---------- python: Python ----------
import os
a = os.path.dirname(ghenv.Component.OnPingDocument().FilePath) + r'\xmls\\'
# ---------- end python ----------
# Update the path to the correct folder on
# your machine.
panel = Panel(python)
concat = Concatenate(FragmentA=panel, FragmentB="clear.xml")
concat_2 = Concatenate(FragmentA=panel, FragmentB="diffuse50.xml")
merge = Merge(Data1=concat, Data2=concat_2)

# ---- group: context!
brep = Brep([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])
panel_2 = Panel("6")

# ----
# Window Groups
# We are adding two window groups for
# this study. The skylight is its own window group
# which is not dynamic but we're interested
# to study its contribution separately.
# South window is the other window group
# which has two states: 1. clear, 2. diffuse50
# 
# Ensure that window groups are facing outwards.
# Honeybee flips the surfaces for view
# matrix calculation internally.
# 
# Window groups are under ./scene/wgroup
radbsdfmat = HoneybeePlus_RadianceBSDFMaterial(xmlfile=merge, up_vec=Vector(0.01, 0.01, 1), thickness=0)  # -> material; plug-in component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
# Context is part of the scene that won't
# change for paramteric studies. We
# just write them to a file once and include
# them in the analysis. For multi-phase
# studies it will only be part of the scene
# for daylight matrix calculation.
# 
# If copyLocal is True the file will be copied
# to ./scene/extra
# 
# NOTE: You can always create the context
# using HBSurface similar to the rest of the
# scene. This method will save you time for
# iterative studies.
# Context
hbsurface = HoneybeePlus_HoneybeeSurface(geo=brep, type=panel_2)  # -> report, HB_srf; plug-in component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
# Three phase daylight simulation example
# If this is the first time you're hearing about 3-phase simulation then first check this link:
# 
# The Three-Phase Method for Simulating Complex  Fenestration with Radiance by A McNeil, LBNL
# https://www.radiance-online.org/learning/tutorials/Tutorial-ThreePhaseMethod.pdf
txt = Text("https://www.energyplus.net/weather-download/north_and_central_america_wmo_region_4/USA/IL/USA_IL_Chicago-OHare.725300_TMY2/all")
# Geometry Preparation
number_slider = Slider(0.762, range=0..1)
downloadepw = LBDownloadWeather(weather_URL=txt)  # -> epw_file, stat_file, ddy_file; plug-in component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
item = ListItem(List=radbsdfmat, Index=0, Wrap=True)  # -> Item, Item1
# Generate test points
# You can use any other grasshopper
# components to generate these points.
brep_2 = Brep(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)
genpts = LBGeneratePointGrid(geometry=brep_2, grid_size="1", dist_surface=number_slider)  # -> points, vectors, face_areas, mesh; plug-in component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
# Room geometry except for the openings.
# Types and materials will be assigned
# based on normal direction.
# 
# These geometries are under ./scene/opaque
brep_3 = Brep([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])

# ---- group: weathe file
path = FilePath(downloadepw.epw_file)

# ----
# Side windows are added to the scene
# as normal windows. They will be grouped
# together with room geometries.
# check ./scene/glazing
wires = BrepWireframe(Brep=brep_3, Density=-1)
brep_4 = Brep(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)
wingroupstate = HoneybeePlus_WindowGroupState(name="diffuse", rad_mat=item.Item1)  # -> report, state; plug-in component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
wea = HoneybeePlus_WEAFromEPW(epw_file=path)  # -> wea; plug-in component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
brep_5 = Brep([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])
preview = CustomPreview(Geometry=wires, Shader=ColourSwatch(SwatchColor=RGB(0, 0, 0)))
brep_6 = Brep(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)

# ---- group: skylight
hbwingroup = HoneybeePlus_HoneybeeWindowGroup(geo=brep_6, name="skylight", rad_mat=item.Item)  # -> report, HB_win_group; plug-in component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

# ---- group: side windows as part of the scene.
hbwinsrf = HoneybeePlus_HoneybeeWindowSurface(geo=brep_5, names="side_window")  # -> report, HB_win_srf; plug-in component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

# ---- group: south window
hbwingroup_2 = HoneybeePlus_HoneybeeWindowGroup(geo=brep_4, name="south_window", rad_mat=item.Item, states=wingroupstate.state)  # -> report, HB_win_group; plug-in component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

# ----
hbsurface_2 = HoneybeePlus_HoneybeeSurface(geo=brep_3, names="room_surface")  # -> report, HB_srf; plug-in component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
# Sky Matrix
# You can use hoys input for subannual simulation.
# Sky will be created under ./sky folder.
skymatrix = HoneybeePlus_SkyMatrix(north=0, wea=wea, density=1)  # -> skymtx; plug-in component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
hbtorad = HoneybeePlus_WriteHBObjectsToRadiance(HB_objects=hbsurface.HB_srf, folder="c:\ladybug\sample_files\context", file_name="context.rad", write=Toggle(True))  # -> rad_file; plug-in component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
# Analysis Grid
analysisgrid = HoneybeePlus_AnalysisGrid(name="room_w_skylight", test_points=genpts.points, pts_vectors=genpts.vectors)  # -> analysis_grid; plug-in component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
radscene = HoneybeePlus_RadianceScene(rad_files=hbtorad, copy_local=True, overwrite=True)  # -> rad_scene; plug-in component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

# ---- group: use the results of previous study if exist
toggle = BooleanToggle(True)

# ----
# Recipe
threephasegbrecipe = HoneybeePlus_GridBasedThreePhaseDaylightRecipe(skymtx=skymatrix, analysis_grids=analysisgrid, analysis_type=0, reuse_vmtx=toggle, reuse_dmtx=toggle)  # -> analysis_recipe; plug-in component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
# Run the simulation
# Set write to True to save the files to
# the project folder. This gives you the
# option to check the files before running
# the simulation.
# 
# Once ready also set run to True and the
# component will run the study. The output
# will be the analysis grids or an image
# collection based on the analysis type.
# 
# Results will be stored under ./result
data = Data(flatten([hbsurface_2.HB_srf, hbwingroup.HB_win_group, hbwingroup_2.HB_win_group, hbwinsrf.HB_win_srf]))
runradiance = HoneybeePlus_RunRadianceAnalysis(
    analysis_recipe=threephasegbrecipe,
    HB_objects=data,
    rad_scene=radscene,
    folder="c:\ladybug",
    name="hbp_sample_files",
    write=Toggle(False),
    run=Toggle(False))  # -> report, legend_par, outputs; plug-in component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
panel_3 = Panel(runradiance.report)
python_2 = GhPythonScript(legend_par=runradiance.legend_par, max="100")  # -> legend_par
# ---------- python_2: Python ----------
if _legend_par:
    if max_:
        _legend_par.max = max_
    
    legend_par = _legend_par
# ---------- end python_2 ----------
# Post process
# Result visualization
# Check the other file for the first two options
# for post-processing data and result visualization.
mesh = Mesh(genpts.mesh)
data_2 = Data(runradiance.outputs)
panel_4 = Panel(data_2)
# 4. Annual metrics - Dynamic blinds
# This workflow shows how to use a sensor to calculate
# blind states and use them to calculate the annual
# daylight metrics. In this case we want to see who far we
# need to go to keep the illuminance at the sensor less than 3000 lux.
# 
# The stratrgy is if illum > 3000 try the steps below:
# 1. change the state of the south window to diffuse (0, 1, 0).
# 2. fully close the side windows. We don't expect this to have
# a major effect considering the location of the sensor (-1, 1, 0).
# 3. close the skylight (-1, 1, -1)
panel_5 = Panel("""100
3000""")
# 3. Annual metrics
# You can use the output of any of the annual studies
# to calculate annual daylight metrics. In this example
# we are calculating Useful Daylight Autonomy (UDI)
# inside the room. As you can see the UDI is pretty low in the
# front and back of the room.
# 
# See number 4. to see how you can consider blind states
# in calculating the annual metrics.
ladybug = Ladybug_Ladybug()  # -> Vviiiiiiiiiizzz; plug-in component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
sensor = HoneybeePlus_SensorFromAnalysisGrid(analysis_grid=data_2, index=Slider(39, range=0..100))  # -> position, sensor; plug-in component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
panel_6 = Panel("""0, 1, 0
-1, 1, 0
-1, 1, -1""")
annualmetrics = HoneybeePlus_AnnualDaylightMetrics(analysis_grid=data_2, min_max=panel_5)  # -> report, DA, CDA, UDI, UDI_less, UDI_more, legend_par; plug-in component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
panel_7 = Panel("100")
dynblindschd = HoneybeePlus_DynamicBlindsSchedule(sensor=sensor.sensor, blind_combs=panel_6, logic="ill > 3000")  # -> report, blind_states, blind_st_index, illum_total, illum_direct, success; plug-in component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
panel_8 = Panel(dynblindschd.report)
heatmap = LBSpatialHeatmap(values=annualmetrics.UDI, mesh=mesh, legend_par=python_2, legend_title="%", global_title="UDI")  # -> mesh, legend, title, colors, legend_par; plug-in component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

# ---- group: draw charts
toggle_2 = BooleanToggle(True)

# ----
entwine = Entwine(
    Branch00=dynblindschd.blind_st_index,
    Branch01=dynblindschd.success,
    Branch02=dynblindschd.illum_total,
    FlattenInputs=True)
annualmetrics_2 = HoneybeePlus_AnnualDaylightMetrics(analysis_grid=data_2, blind_states=dynblindschd.blind_states)  # -> report, DA, CDA, UDI, UDI_less, UDI_more, legend_par; plug-in component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
# Set to True to see the charts for the sensor.
filter = StreamFilter(Gate=toggle_2, Stream1=entwine)
bang = ExplodeTree(Data=filter)  # -> Branch0, Branch1, Branch2
# Turn on the preview of this component
# to see the effect of dynamic blinds!
# 
# Check the charts below to see what are
# the blind states based on the goal (illum < 3000)
heatmap_2 = LBSpatialHeatmap(values=annualmetrics_2.CDA, mesh=mesh, legend_par=python_2)  # -> mesh, legend, title, colors, legend_par; plug-in component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
python_3 = GhPythonScript(name="Blind combination", unit="state")  # -> data_type
# ---------- python_3: Python ----------
from ladybug.datatype.generic import GenericType

if _name and _unit:
    data_type = GenericType(_name, _unit)
# ---------- end python_3 ----------
python_4 = GhPythonScript(name="-1 : Failed, 0: Met the goal w/o blinds, 1: Succeed", unit="success")  # -> data_type; same code as python_3
constrheader = LBConstructHeader(data_type="Illuminance", unit="lux")  # -> header; plug-in component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
constrheader_2 = LBConstructHeader(data_type=python_3)  # -> header; plug-in component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
constrheader_3 = LBConstructHeader(data_type=python_4)  # -> header; plug-in component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
data_3 = LBConstructData(header=constrheader, values=bang.Branch2)  # -> data; plug-in component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
data_4 = LBConstructData(header=constrheader_3, values=bang.Branch1)  # -> data; plug-in component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
data_5 = LBConstructData(header=constrheader_2, values=bang.Branch0)  # -> data; plug-in component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
lng = ListLength(List=panel_6)
col = Colour([ColourSwatch(SwatchColor=RGBA(0, 0, 0, 194)), ColourSwatch(SwatchColor=RGB(139, 129, 123)), ColourSwatch(SwatchColor=RGB(141, 230, 253))])
colrange = LBColorRange(index="15")  # -> colors; plug-in component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
subtraction = Subtraction(A=lng, B="1")
legendpar = LBLegendParameters(max=subtraction, seg_count=lng, colors=colrange)  # -> leg_par; plug-in component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
legendpar_2 = LBLegendParameters(min="-1", max="1", seg_count="3", colors=col)  # -> leg_par; plug-in component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

# ---- group: scale
panel_9 = Panel("0.1")
panel_10 = Panel("0.5")
panel_11 = Panel("0")

# ----
legendpar_3 = LBLegendParameters(max="3000")  # -> leg_par; plug-in component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
hourlyplot = LBHourlyPlot(data=data_5, base_pt="{20, 10, 0}", x_dim=panel_9, y_dim=panel_10, z_dim=panel_11, legend_par=legendpar)  # -> report, mesh, legend, borders, labels, title; plug-in component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
hourlyplot_2 = LBHourlyPlot(data=data_4, base_pt="{20, -10, 0}", x_dim=panel_9, y_dim=panel_10, z_dim=panel_11, legend_par=legendpar_2)  # -> report, mesh, legend, borders, labels, title; plug-in component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
hourlyplot_3 = LBHourlyPlot(data=data_3, base_pt="{20, -30, 0}", x_dim=panel_9, y_dim=panel_10, z_dim=panel_11, legend_par=legendpar_3)  # -> report, mesh, legend, borders, labels, title; plug-in component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
